# Grasshopper definition 2d_Shadows.gh (Grasshopper 1.0.7)
# plug-ins: Pufferfish, Human

pipeline = GeometryPipeline(
    GroupByLayer=False,
    GroupByType=False,
    IncludeHidden=True,
    IncludeLocked=True,
    LayerFilter="BUILDING",
    NameFilter="*",
    SublayerFiltering=True,
    TypeFilter=4)
bake = Button()
delete_all = Button()
pipeline_2 = GeometryPipeline(
    GroupByLayer=False,
    GroupByType=False,
    IncludeHidden=True,
    IncludeLocked=True,
    LayerFilter="WINDOW",
    NameFilter="*",
    SublayerFiltering=True,
    TypeFilter=4)
pipeline_3 = GeometryPipeline(
    GroupByLayer=False,
    GroupByType=False,
    IncludeHidden=True,
    IncludeLocked=True,
    LayerFilter="BALU_CONTROL",
    NameFilter="*",
    SublayerFiltering=True,
    TypeFilter=4)
layers = CreateModifyLayers(LayerName="BUILDINGHATCH", LayerColor=RGB(117, 166, 114), DeleteLayer=False, enableFullPath=False)  # -> LayerNames, LayerFullPath
balu_height = Slider(900, range=0..1000)
createatts = CreateAttributes(LayerName=layers.LayerNames, enableFullPath=False)
objatts = ObjectAttributes(ObjectOrAttributes=pipeline_3)  # -> Name, LayerName, LayerFullPath, Color, MaterialName, LinetypeName, GroupIndices, PlotWeight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
number_slider = Slider(150, range=0..150)
crv = Curve(pipeline_2)
boundary = BoundarySurfaces(Edges=pipeline_2)
nullrep = ReplaceNulls(Items=objatts.Name, Replacements=balu_height)  # -> graft(Items), Count
pipeline_4 = GeometryPipeline(
    GroupByLayer=False,
    GroupByType=False,
    IncludeHidden=True,
    IncludeLocked=True,
    LayerFilter="BALCONY",
    NameFilter="*",
    SublayerFiltering=True,
    TypeFilter=4)
join = BrepJoin(Breps=boundary)  # -> Breps, Closed
crv_2 = Curve(graft(pipeline_3))
createatts_2 = CreateAttributes(LayerName="BALCONYSLABHATCH", enableFullPath=False)
layers_2 = CreateModifyLayers(LayerName="FRAMELINE", LayerColor=RGB(166, 114, 114), DeleteLayer=False, enableFullPath=False)  # -> LayerNames, LayerFullPath
expression = Expression(x=number_slider, Expression="x/2*-1")
brec = BoundingRectangle(Geometry=graft(join.Breps), Plane=PlaneXY(0, 0, 0), Axis=0, Slide=0, Union=True)
ext = ExtendCurve(Curve=pipeline_3, Type=0, Start=expression, End=expression)
frame = Slider(100, range=0..100)
panel = Panel("""1
0
3""")
Y = UnitY(Factor=nullrep.Items)
Y_2 = UnitY(Factor=1)
createatts_3 = CreateAttributes(LayerName=layers_2.LayerNames, enableFullPath=False)
layers_3 = CreateModifyLayers(LayerName="BALUSTRADE", LayerColor=RGB(138, 138, 138), DeleteLayer=False, enableFullPath=False)  # -> LayerNames, LayerFullPath
crv_3 = Curve(brec)
divlength = DivideLength(Curve=ext, Length=number_slider)  # -> Points, Tangents, Parameters
vec = VectorXYZ(XComponent=expr("x*-1", Slider(610, range=0..1000)), YComponent=expr("x*-1", Slider(534, range=0..1000)), ZComponent=0)  # -> Vector, Length
cp = ControlPoints(Curve=pipeline_4)  # -> Points, Weights, Knots
move = Move(Geometry=crv_2, Motion=Y)  # -> Geometry, Transform
line = LineSDL(Start=divlength.Points, Direction=Y_2, Length=nullrep.Items)
item = ListItem(List=cp.Points, Index=panel, Wrap=True)
createatts_4 = CreateAttributes(LayerName=layers_3.LayerNames, enableFullPath=False)
offcrv = OffsetCurve(Curve=crv, Distance=expr("x*-1", frame), Plane=PlaneXY(0, 0, 0), BothSides=False, Kinks=0, CapType=1)  # -> flatten(Offset)
crv_4 = Curve([move.Geometry, line])
pline = PolyLine(Vertices=item, Closed=False)
cp_2 = ControlPoints(Curve=crv_3)  # -> Points, Weights, Knots
panel_2 = Panel("""0
1
1
1
0""")
layers_4 = CreateModifyLayers(LayerName="FRAME", LayerColor=RGB(166, 114, 114), DeleteLayer=False, enableFullPath=False)  # -> LayerNames, LayerFullPath
move_2 = Move(Geometry=pline, Motion=vec.Vector)  # -> Geometry, Transform
Y_3 = UnitY(Factor=Slider(279, range=0..300))
loft = Loft(
    Curves=[pline, move_2.Geometry],
    Options={Adjust=False, Closed=False, LoftEnds=0, LoftSimp=0, LoftType=0, Rebuild=10, Refit=0.01})
weave = Weave(Pattern=[0, 1], Stream0=crv, Stream1=flatten(offcrv), NullGaps=False)
createatts_5 = CreateAttributes(LayerName=layers_4.LayerNames, enableFullPath=False)
dispatch = Dispatch(List=cp_2.Points, DispatchPattern=panel_2)  # -> ListA, ListB
join_2 = BrepJoin(Breps=loft)  # -> Breps, Closed
pline_2 = PolyLine(Vertices=dispatch.ListA, Closed=False)  # -> flatten(Polyline)
fmerge = MergeFaces(Brep=join_2.Breps)  # -> Breps, Before, After
edges = BrepEdges(Brep=fmerge.Breps)  # -> Naked, Interior, NonManifold
layers_5 = CreateModifyLayers(LayerName="SHADOW", DeleteLayer=False, enableFullPath=False)  # -> LayerNames, LayerFullPath
offcrv_2 = OffsetCurve(
    Curve=pline_2,
    Distance=expr("x*-1", Slider(133, range=0..1000)),
    Plane=PlaneXY(0, 0, 0),
    BothSides=False,
    Kinks=0,
    CapType=1)
join_3 = JoinCurves(Curves=edges.Naked, Preserve=False)  # -> flatten(Curves)
cp_3 = ControlPoints(Curve=offcrv_2)  # -> Points, Weights, Knots
item_2 = ListItem(List=cp_3.Points, Index=["1", "2"], Wrap=False)
move_3 = Move(Geometry=item_2, Motion=Y_3)  # -> Geometry, Transform
replace = ReplaceItems(List=cp_3.Points, Item=move_3.Geometry, Indices="1", Wrap=False)
pline_3 = PolyLine(Vertices=replace, Closed=False)
createatts_6 = CreateAttributes(LayerName=layers_5.LayerNames, Color=RGB(0, 0, 0), enableFullPath=False)
layers_6 = CreateModifyLayers(LayerName="GLASS", LayerColor=RGB(230, 230, 230), DeleteLayer=False, enableFullPath=False)  # -> LayerNames, LayerFullPath
createatts_7 = CreateAttributes(LayerName=layers_6.LayerNames, enableFullPath=False)
pipeline_5 = GeometryPipeline(
    GroupByLayer=False,
    GroupByType=False,
    IncludeHidden=True,
    IncludeLocked=True,
    LayerFilter="RECESS",
    NameFilter="*",
    SublayerFiltering=True,
    TypeFilter=4)
pipeline_6 = GeometryPipeline(
    GroupByLayer=False,
    GroupByType=False,
    IncludeHidden=True,
    IncludeLocked=True,
    LayerFilter="COLUMN",
    NameFilter="*",
    SublayerFiltering=True,
    TypeFilter=4)
layers_7 = Text(["SHADOW", "FRAME", "GLASS", "FRAMELINE", "BALUSTRADE", "BUILDINGHATCH", "COLUMNHATCH", "BALCONYSLABHATCH"])
delonlay = DeleteOnLayer(Run=delete_all, Layer=layers_7, enableFullPath=False)
delonlay_2 = DeleteOnLayer(Run=bake, Layer=layers_7, enableFullPath=True)
createhatch = CreateHatch(
    Bake=delonlay_2,
    Curves=[pipeline_2, pipeline],
    HatchPatternName="Solid",
    HatchScale=1,
    HatchRotation=0,
    Attributes=createatts)  # -> HatchGeometry, HatchObjects
area = Area(Geometry=createhatch.HatchGeometry)  # -> Area, Centroid
ma = MassAddition(Input=area.Area)  # -> Result, PartialResults
expression_2 = Expression(x=ma.Result, Expression="Format(\"{0:0.00} m²\", X / 1000²)")
panel_3 = Panel(expression_2)
createhatch_2 = CreateHatch(Bake=delonlay_2, Curves=pipeline_4, HatchPatternName="Solid", HatchScale=1, HatchRotation=0, Attributes=createatts_2)  # -> HatchGeometry, HatchObjects
bake_2 = BakeGeometry(Bake=delonlay_2, Geometry=offcrv, Attributes=createatts_3, DeleteOldBakes=False, PreserveTrees=False)
bake_3 = BakeGeometry(Bake=delonlay_2, Geometry=crv_4, Attributes=createatts_4, DeleteOldBakes=False, PreserveTrees=False)
createhatch_3 = CreateHatch(Bake=delonlay_2, Curves=weave, HatchPatternName="Solid", HatchScale=1, HatchRotation=0, Attributes=createatts_5)  # -> HatchGeometry, HatchObjects
createhatch_4 = CreateHatch(
    Bake=delonlay_2,
    Curves=flatten(pline_3),
    HatchPatternName="Solid",
    HatchScale=1,
    HatchRotation=0,
    Attributes=createatts_6)  # -> HatchGeometry, HatchObjects
createhatch_5 = CreateHatch(Bake=delonlay_2, Curves=join_3, HatchPatternName="Solid", HatchScale=1, HatchRotation=0, Attributes=createatts_6)  # -> HatchGeometry, HatchObjects
createhatch_6 = CreateHatch(Bake=delonlay_2, Curves=crv, HatchPatternName="Solid", HatchScale=1, HatchRotation=0, Attributes=createatts_7)  # -> HatchGeometry, HatchObjects
boundary_2 = BoundarySurfaces(Edges=pipeline_5)
layers_8 = CreateModifyLayers(LayerName="COLUMNHATCH", LayerColor=RGB(117, 166, 114), DeleteLayer=False, enableFullPath=False)  # -> LayerNames, LayerFullPath
join_4 = BrepJoin(Breps=boundary_2)  # -> Breps, Closed
panel_4 = Panel("""1
0
3""")
createatts_8 = CreateAttributes(LayerName=layers_8.LayerNames, enableFullPath=False)
brec_2 = BoundingRectangle(Geometry=graft(join_4.Breps), Plane=PlaneXY(0, 0, 0), Axis=0, Slide=0, Union=True)
cp_4 = ControlPoints(Curve=pipeline_6)  # -> Points, Weights, Knots
item_3 = ListItem(List=cp_4.Points, Index=panel_4, Wrap=True)
crv_5 = Curve(brec_2)
pline_4 = PolyLine(Vertices=item_3, Closed=False)
cp_5 = ControlPoints(Curve=crv_5)  # -> Points, Weights, Knots
vec_2 = VectorXYZ(XComponent=expr("x*-1", Slider(200, range=0..1000)), YComponent=expr("x*-1", Slider(0, range=0..1000)), ZComponent=0)  # -> Vector, Length
move_4 = Move(Geometry=pline_4, Motion=vec_2.Vector)  # -> Geometry, Transform
loft_2 = Loft(
    Curves=[pline_4, move_4.Geometry],
    Options={Adjust=False, Closed=False, LoftEnds=0, LoftSimp=0, LoftType=0, Rebuild=10, Refit=0.01})
join_5 = BrepJoin(Breps=loft_2)  # -> Breps, Closed
Y_4 = UnitY(Factor=Slider(56, range=0..300))
fmerge_2 = MergeFaces(Brep=join_5.Breps)  # -> Breps, Before, After
createhatch_7 = CreateHatch(Bake=delonlay_2, Curves=pipeline_6, HatchPatternName="Solid", HatchScale=1, HatchRotation=0, Attributes=createatts_8)  # -> HatchGeometry, HatchObjects
dispatch_2 = Dispatch(List=cp_5.Points, DispatchPattern=panel_2)  # -> ListA, ListB
edges_2 = BrepEdges(Brep=fmerge_2.Breps)  # -> Naked, Interior, NonManifold
pline_5 = PolyLine(Vertices=dispatch_2.ListA, Closed=False)  # -> flatten(Polyline)
join_6 = JoinCurves(Curves=edges_2.Naked, Preserve=False)  # -> flatten(Curves)
offcrv_3 = OffsetCurve(
    Curve=pline_5,
    Distance=expr("x*-1", Slider(196, range=0..1000)),
    Plane=PlaneXY(0, 0, 0),
    BothSides=False,
    Kinks=0,
    CapType=1)
cp_6 = ControlPoints(Curve=offcrv_3)  # -> Points, Weights, Knots
item_4 = ListItem(List=cp_6.Points, Index=["1", "2"], Wrap=False)
move_5 = Move(Geometry=item_4, Motion=Y_4)  # -> Geometry, Transform
replace_2 = ReplaceItems(List=cp_6.Points, Item=move_5.Geometry, Indices="1", Wrap=False)
pline_6 = PolyLine(Vertices=replace_2, Closed=False)
createhatch_8 = CreateHatch(Bake=delonlay_2, Curves=join_6, HatchPatternName="Solid", HatchScale=1, HatchRotation=0, Attributes=createatts_6)  # -> HatchGeometry, HatchObjects
createhatch_9 = CreateHatch(Bake=delonlay_2, Curves=pline_6, HatchPatternName="Solid", HatchScale=1, HatchRotation=0, Attributes=createatts_6)  # -> HatchGeometry, HatchObjects
