# Grasshopper definition TOOL_Area_Calculator.gh (Grasshopper 1.0.7)

# ---- group: INPUT
# Calculate Area(s) of the FOOTPRINT of GEOMETRY
# 1. Set Rhino as GEOMETRY
# 2. Read total/individual area
# 3. Bake TAGS (Output)
geometry = Brep([<brep referenced from the Rhino model> x20])

# ----
cluster = Cluster(B_2=geometry, B=geometry, C=geometry)  # -> R, R_2, pt, pt_2

# ---- group: AREA TOTAL
panel = Panel(cluster.R_2)

# ---- group: AREA INDIVIDUAL OBJECT
panel_2 = Panel(cluster.R)

# ---- group: OUTPUT TAG TOTAL AREA
tag = TextTag3D(
    Location=cluster.pt_2,
    Text=panel,
    Size=Slider(10, range=0..10),
    Colour=ColourSwatch(SwatchColor=RGB(255, 255, 0)),
    Justification=7)

# ---- group: OUTPUT TAG INDIVIDUAL AREA
tag_2 = TextTag3D(
    Location=cluster.pt,
    Text=cluster.R,
    Size=Slider(5, range=0..10),
    Colour=ColourSwatch(SwatchColor=RGB(255, 153, 0)),
    Justification=7)

# ==== cluster Cluster
B = ClusterInput()
B_2 = ClusterInput()
box = EvaluateBox(Box=B, UParameter=1, VParameter=1, WParameter=0.01)  # -> Plane, Point, Include
sec = BrepPlane(Brep=B_2, Plane=box.Plane)  # -> Curves, Points
pt = ClusterOutput(box.Point)
planar = Planar(Curve=flatten(sec.Curves))  # -> Planar, Plane, Deviation
point = Point(planar.Plane)
deconstruct = Deconstruct(Point=point)  # -> XComponent, YComponent, ZComponent
create_set = CreateSet(List=deconstruct.ZComponent)  # -> Set, Map
member_index = MemberIndex(Set=deconstruct.ZComponent, Member=create_set.Set)  # -> Index, Count
list_item = ListItem(List=flatten(sec.Curves), Index=member_index.Index, Wrap=True)
region_union = RegionUnion(Curves=list_item)
C = ClusterInput()
area = Area(Geometry=region_union)  # -> Area, Centroid
bbox = BoundingBox(Content=C, Plane=PlaneXY(0, 0, 0), UnionBox=True)  # -> Box, Box_2
ma = MassAddition(Input=area.Area)  # -> flatten(Result), PartialResults
box_2 = EvaluateBox(Box=bbox.Box, UParameter=1, VParameter=0, WParameter=0)  # -> Plane, Point, Include
pt_2 = ClusterOutput(box_2.Point)
R = ClusterOutput(ma.Result)
ma_2 = MassAddition(Input=ma.Result)  # -> Result, PartialResults
R_2 = ClusterOutput(ma_2.Result)
