# Grasshopper definition TOOL_People_placer.gh (Grasshopper 0.9.76)

mesh = Mesh([<mesh referenced from the Rhino model> x8])

panel = Panel("People placer")
number_slider = Slider(245, range=0..1000)
srf = Surface(<surface referenced from the Rhino model>)
series = Series(Start=0, Step=1, Count=Slider(20, range=0..100))
random = Random(Range=number_slider, Number=1, Seed=series)
popgeo = PopulateGeometry(Geometry=srf, Count=number_slider, Seed=Slider(4, range=0..10))
random_2 = Random(Range=Slider(7, range=0..10), Number=1, Seed=series)
int = Integer(random)
int_2 = Integer(random_2)
item = ListItem(List=popgeo, Index=int, Wrap=True)  # -> graft(Item)
cps = ClosestPoints(Point=item, Cloud=popgeo, Count=int_2)  # -> ClosestPoint, CPIndex, Distance
ln = Line(StartPoint=item, EndPoint=cps.ClosestPoint)
eval = EvaluateCurve(Curve=ln, Parameter=Slider(0.464, range=0..1))  # -> Point, Tangent, Angle

lng = ListLength(List=cps.ClosestPoint)  # -> flatten(Length)
ma = MassAddition(Input=lng)  # -> Result, PartialResults
repeat = RepeatData(Data=mesh, Length=ma.Result)
jitter = Jitter(List=repeat, Jitter=1, Seed=2)  # -> Values, Indices
panel_2 = Panel("Distribute objects")

pt = ConstructPoint(XCoordinate=0, YCoordinate=0, ZCoordinate=0)
mesh_2 = Mesh(jitter.Values)

crv = Curve(<curve referenced from the Rhino model>)

bbox = BoundingBox(Content=mesh_2, Plane=PlaneXY(0, 0, 0))  # -> Box, Box_2
lng_2 = ListLength(List=mesh_2)
debrep = DeconstructBrep(Brep=bbox.Box)  # -> Faces, Edges, Vertices
series_2 = Series(Start=0, Step=Slider(7, range=0..100), Count=lng_2)
item_2 = ListItem(List=debrep.Faces, Index=Slider(4, range=0..10), Wrap=True)
Y = UnitY(Factor=series_2)
area = Area(Geometry=flatten(item_2))  # -> Area, Centroid
move = Move(Geometry=pt, Motion=Y)  # -> Geometry, Transform
vec2pt = Vector2Pt(PointA=area.Centroid, PointB=flatten(eval.Point), Unitize=False)  # -> flatten(Vector), Length
move_2 = Move(Geometry=flatten(mesh_2), Motion=vec2pt.Vector)  # -> Geometry, Transform

panel_3 = Panel("On line")
one_over_x = OneOverX(Value=lng_2)
division = Division(A=one_over_x, B=2)
series_3 = Series(Start=division, Step=one_over_x, Count=lng_2)
eval_2 = EvaluateCurve(Curve=reparameterize(crv), Parameter=series_3)  # -> Point, Tangent, Angle
rad = Radians(Degrees=Slider(133, range=0..360))
rotate = Rotate(Geometry=move_2.Geometry, Angle=rad, Plane=eval_2.Point)  # -> Geometry, Transform

random_3 = Random(Range=Slider(173, range=0..360), Number=ma.Result, Seed=2)
rad_2 = Radians(Degrees=random_3)
rotate_2 = Rotate(Geometry=move_2.Geometry, Angle=rad_2, Plane=flatten(eval.Point))  # -> Geometry, Transform

preview = CustomPreview(Geometry=rotate_2.Geometry, Shader=ColourSwatch(SwatchColor=RGB(255, 217, 0)))
